# Grasshopper definition CreaseMachine-Demo.gh (Grasshopper 1.0.8)
# plug-ins: CreaseMachine

weld = BooleanToggle(False)
showenergy = BooleanToggle(False)
subdiv = Button()
reset = Button()
usemaxcov = BooleanToggle(True)
running = BooleanToggle(False)
mesh = Mesh(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)
mesh_2 = Mesh(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)
trigger = Trigger(Interval=-1000, TimerInterval=1000, Target=sheetbender)
mesh_3 = Mesh(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)
sheetbender = SheetBender(
    Mesh=mesh_2,
    Step=Slider(0.0043, range=0..0.1),
    Momentum=0.9,
    Iterations="1",
    Subdivide=subdiv,
    Reset=reset,
    DeBranch=Slider(0, range=0..0.7),
    DeConsolidate=Slider(0, range=0..0.7),
    UseMaxCov=usemaxcov,
    Sharpness=Slider(8, range=2..8),
    DeCraze=Slider(0, range=0..6),
    Running=running,
    DetMix=Slider(0, range=0..1))  # -> Mesh, Energy, BrushWeights
mesh_4 = Mesh(sheetbender.Mesh)
filter = StreamFilter(Gate=showenergy, Stream1=sheetbender.Energy)
filter_2 = StreamFilter(Gate=showenergy, Stream1=mesh_4)
unweld = UnweldMesh(Mesh=mesh_4, Angle="0")
bnd = Bounds(Numbers=filter)
panel = Panel("0.0003")
demesh = DeconstructMesh(Mesh=filter_2)  # -> Vertices, Faces, Colours, Normals
filter_3 = StreamFilter(Gate=weld, Stream0=unweld, Stream1=mesh_4)
dedomain = DeconstructDomain(Domain=bnd)  # -> Start, End
gradient = Gradient(
    LowerLimit=dedomain.Start,
    UpperLimit=dedomain.End,
    Parameter=filter,
    stops=[0: RGBA(255, 255, 255, 0), 0.7: RGB(255, 255, 0), 1: RGB(255, 0, 0)])
filter_4 = StreamFilter(Gate=showenergy, Stream0=filter_3)
number_slider = Slider(0, range=0..100)
mesh_5 = Mesh(filter_4)
num = Number("0")
swatch = ColourSwatch(SwatchColor=RGB(255, 255, 255))
conmesh = ConstructMesh(Vertices=demesh.Vertices, Faces=demesh.Faces, Colours=gradient)
emap = MeshEnvironmentMap(Meshes=mesh_5, Environment=Slider(2, range=0..11), EdgeWidth=num, EdgeColor="black")  # inputs Meshes: list
# ---------- emap: Python ----------
"""
Draw Meshes with an environment map.
    Inputs:
        Meshes: Meshes to draw {list,mesh}
        Environment: A Rhino native map is selected when value is number, 
        an image on disk is used if value is text/path {item,float or string}
        EdgeWidth: Width of mesh edges {item,float}
        EdgeColor: Color of mesh edges {item,color}
    Outputs:
    Remarks:
        Author: Anders Holden Deleuran (BIG CPH)
        Rhino: 7.37.24107.15001
        Version: 240703
"""

ghenv.Component.Name = "MeshEnvironmentMap"
ghenv.Component.NickName = "EMAP"

import os
import Rhino as rc
import GhPython.Assemblies.ExecutingComponent as component

class MyComponent(component):
    
    def RunScript(self,Meshes,Environment,EdgeWidth,EdgeColor):
        
            # Assign input parameters
            self.meshes = Meshes
            self.edgeWidth = EdgeWidth
            self.edgeColor = EdgeColor
            if Meshes and Environment:
                
                # Get local Rhino environment map to use
                if type(Environment) is float:
                    temFolder = rc.ApplicationSettings.FileSettings.TemplateFolder
                    envFolder = temFolder.replace("Template Files","Environment Maps")
                    envFile =  os.path.join(envFolder,os.listdir(envFolder)[int(Environment)])
                    
                # Or use a string defining file path
                elif type(Environment) is str and os.path.isfile(Environment):
                    envFile = Environment
                    
                # Make display material
                self.dm = rc.Display.DisplayMaterial()
                self.dm.SetBitmapTexture("",True)
                self.dm.SetEnvironmentTexture(envFile,True)
                
    def DrawViewportMeshes(self,arg):
        for m in self.meshes:
            if m:
                arg.Display.DrawMeshShaded(m,self.dm)
                
    def DrawViewportWires(self,arg):
        if self.edgeWidth and self.edgeColor:
            for m in self.meshes:
                if m:
                    arg.Display.DrawMeshWires(m,self.edgeColor,self.edgeWidth)
# ---------- end emap ----------
